% Simulink data dictionary ModelDictionary.sldd

EtherCATReceivedFromBMS = Simulink.Bus()
  stateBMS: double
  statusChargeBattery: double
  statusTemperatureBattery: double
  minVoltCell: double
  maxVoltCell: double

EtherCATReceivedFromInputDevice = Simulink.Bus()
  desiredState: double
  error: double

EtherCATReceivedFromPowerElectronics = Simulink.Bus()
  receivedFromPDB: Bus: EtherCATReceivedFromPDB
  receivedFromBMS: Bus: EtherCATReceivedFromBMS

EtherCATSendToPowerElectronics = Simulink.Bus()
  sendToPDB: Bus: EtherCATSendToPDB

GaitGeneratorInput = Simulink.Bus()
  targetLeg: Enum: Leg
  stepType: Enum: StepType

JointDynamics = Simulink.Bus()
  angle: double
  velocity: double
  torque: double

PowerElectronicsError = Simulink.Bus()
  errorPDB: double
  errorBMS: double

JointControlConfigLKFE_Param = Simulink.Parameter(struct(
  angleOffset=1245,
  polePairs=21,
  minPosLimit=-200,
  maxPosLimit=200,
  maxSpeed=60,
  maxTorque=2.122,
  positionKp=500000,
  positionKi=0,
  positionKd=0,
  positionIntegralLimit=2122,
  velocityKp=600000,
  velocityKi=10000,
  velocityKd=0,
  velocityIntegralLimit=2122,
  brakeReleaseStrategy=0), DataType="Bus: JointControlConfig")

JointControlConfigRHFE_Param = Simulink.Parameter(struct(
  angleOffset=1245,
  polePairs=21,
  minPosLimit=-200,
  maxPosLimit=200,
  maxSpeed=60,
  maxTorque=2.122,
  positionKp=500000,
  positionKi=0,
  positionKd=0,
  positionIntegralLimit=2122,
  velocityKp=600000,
  velocityKi=10000,
  velocityKd=0,
  velocityIntegralLimit=2122,
  brakeReleaseStrategy=0), DataType="Bus: JointControlConfig")

JointControlConfigRKFE_Param = Simulink.Parameter(struct(
  angleOffset=1245,
  polePairs=21,
  minPosLimit=-200,
  maxPosLimit=200,
  maxSpeed=60,
  maxTorque=2.122,
  positionKp=500000,
  positionKi=0,
  positionKd=0,
  positionIntegralLimit=2122,
  velocityKp=600000,
  velocityKi=10000,
  velocityKd=0,
  velocityIntegralLimit=2122,
  brakeReleaseStrategy=0), DataType="Bus: JointControlConfig")

EtherCATReceivedFromGESJoint = Simulink.Bus()
  temperature: double

JointDynamicCommand = Simulink.Bus()
  jointDynamics: Bus: JointDynamics
  jointCommand: Enum: JointCommand

EtherCATReceivedFromSOMANET = Simulink.Bus()
  statusword: double
  actualAngle: double
  actualVelocity: double
  actualTorque: double
  userMISO: double
  tuningStatus: double
  errorSOMANET: double
  statusPhaseCurrentB: double
  statusPhaseCurrentC: double
  opMode: double
  statusTemperature: double
  timestamp: double
  actualMotorAngle: double
  actualMotorVelocity: double

resolutionMotorEncoder = Simulink.Parameter(4096)

EtherCATReceivedFromGESBack = Simulink.Bus()
  temperatureRHFE: double
  temperatureLHFE: double

GESErrors = Simulink.Bus()
  errorGESLKFE: Enum: GESError
  errorGESRKFE: Enum: GESError
  errorGESBack: Enum: GESError

GaitPhases = Simulink.Bus()
  phaseRightLeg: double
  phaseLeftLeg: double

motorResistance = Simulink.Parameter(0.2)  % Motor Resistance in Ohms. See https://confluence.projectmarch.nl:8443/display/05TECH/Instantaneous+phase+current+to+power+supply+current
backEMFConstant = Simulink.Parameter(131.2)  % BackEMF Constant, in RPM/V. See https://confluence.projectmarch.nl:8443/display/05TECH/Instantaneous+phase+current+to+power+supply+current

EtherCATSendToSOMANET = Simulink.Bus()
  tuningCommand: double
  userMOSI: double
  targetAngle: double
  targetVelocity: double
  targetTorque: double
  controlword: Enum: SomanetControlWord
  opMode: Enum: SomanetOpmode
  maxTorque: double

MiscDataSOMANET = Simulink.Bus()
  jointControlConfigs: Bus: JointControlConfig[1 4]
  somanetData: Bus: SOMANETData[1 4]

SOMANETData = Simulink.Bus()
  somanetState: Enum: SomanetState
  controlState: Enum: SomanetControlState
  opMode: Enum: SomanetOpmode
  somanetError: Enum: SomanetError
  positionKp: double
  positionKi: double
  positionKd: double
  phaseAmplitude: double
  electricPower: double
  surfaceI2t: double

maxHomeAcceleration = 1
maxHomeVelocity = 0.4
resolutionJointEncoder = Simulink.Parameter(65536, DataType="double")
maxTemperature = Simulink.Parameter(120, Unit="degree_Celsius")
maxTemperatureJoint = Simulink.Parameter(100, Unit="degree_Celsius")
maxNonResponsive = Simulink.Parameter(0.3, Unit="second")
gaitFrequency = 500

JointControlConfig = Simulink.Bus()
  angleOffset: double
  polePairs: double
  minPosLimit: double
  maxPosLimit: double
  maxSpeed: double
  maxTorque: double
  positionKp: double
  positionKi: double
  positionKd: double
  positionIntegralLimit: double
  velocityKp: double
  velocityKi: double
  velocityKd: double
  velocityIntegralLimit: double
  softStopThreshold: double

JointControlConfigLHFE_Param = Simulink.Parameter(struct(
  angleOffset=1245,
  polePairs=21,
  minPosLimit=-5,
  maxPosLimit=115,
  maxSpeed=60,
  maxTorque=2.122,
  positionKp=500000,
  positionKi=0,
  positionKd=0,
  positionIntegralLimit=2122,
  velocityKp=600000,
  velocityKi=10000,
  velocityKd=0,
  velocityIntegralLimit=2122,
  brakeReleaseStrategy=0), DataType="Bus: JointControlConfig")

somanetSyncMode = Simulink.Parameter(2)

JointControlConfigRHFE = struct(
  angleOffset=1245,
  polePairs=21,
  minPosLimit=-17.5,
  maxPosLimit=97.5,
  maxSpeed=60,
  maxTorque=2.122,
  positionKp=500000,
  positionKi=0,
  positionKd=0,
  positionIntegralLimit=2122,
  velocityKp=600000,
  velocityKi=10000,
  velocityKd=0,
  velocityIntegralLimit=2122,
  softStopThreshold=2.5)

JointControlConfigRKFE = struct(
  angleOffset=1245,
  polePairs=21,
  minPosLimit=-2.5,
  maxPosLimit=112.5,
  maxSpeed=60,
  maxTorque=2.122,
  positionKp=500000,
  positionKi=0,
  positionKd=0,
  positionIntegralLimit=2122,
  velocityKp=600000,
  velocityKi=10000,
  velocityKd=0,
  velocityIntegralLimit=2122,
  softStopThreshold=2.5)

zeroOffsetLKFE = Simulink.Parameter(174.676, Unit="degree")
zeroOffsetLHFE = Simulink.Parameter(-78.99, Unit="degree")
jointPolarityRHFE = Simulink.Parameter(-1)
jointPolarityRKFE = Simulink.Parameter(-1)
zeroOffsetRKFE = Simulink.Parameter(-68.67, Unit="degree")
zeroOffsetRHFE = Simulink.Parameter(158.87, Unit="degree")
jointPolarityLKFE = Simulink.Parameter(1)
jointPolarityLHFE = Simulink.Parameter(-1)

JointControlConfigLHFE = struct(
  angleOffset=1245,
  polePairs=21,
  minPosLimit=-17.5,
  maxPosLimit=97.5,
  maxSpeed=60,
  maxTorque=2.122,
  positionKp=500000,
  positionKi=0,
  positionKd=0,
  positionIntegralLimit=2122,
  velocityKp=600000,
  velocityKi=10000,
  velocityKd=0,
  velocityIntegralLimit=2122,
  softStopThreshold=2.5)

currentMaximum = Simulink.Parameter(35, Unit="ampere")
currentTimeMaximum = Simulink.Parameter(40, Unit="ampere")
maxPositionDifference = Simulink.Parameter(1, Unit="radian")
maxPhasePeakCurrent = Simulink.Parameter(70, Unit="ampere")

JointControlConfigLKFE = struct(
  angleOffset=1245,
  polePairs=21,
  minPosLimit=-2.5,
  maxPosLimit=112.5,
  maxSpeed=60,
  maxTorque=2.122,
  positionKp=500000,
  positionKi=0,
  positionKd=0,
  positionIntegralLimit=2122,
  velocityKp=600000,
  velocityKi=10000,
  velocityKd=0,
  velocityIntegralLimit=2122,
  softStopThreshold=2.5)

currentNominal = Simulink.Parameter(15, Unit="ampere")
thresholdI2tSurfaceWarning = Simulink.Parameter(0.8)
maxTemperatureSomanet = Simulink.Parameter(85)
thresholdTempWarningSomanet = Simulink.Parameter(60)

motorTransmissionRatio = Simulink.Parameter(101)  % Motor turns/joint turn
  % probably never used

torquePolarityLHFE = Simulink.Parameter(-1)
torquePolarityLKFE = Simulink.Parameter(1)
torquePolarityRHFE = Simulink.Parameter(-1)
torquePolarityRKFE = Simulink.Parameter(-1)

IMUInfo = Simulink.Bus()
  angleX: double
  angleY: double
  angleZ: double

ExoskeletonData = Simulink.Bus()
  etherCATData: Bus: EtherCATData
  error: Bus: DeviceErrors
  masterInfo: Bus: MasterInfo
  miscDataSOMANETs: Bus: MiscDataSOMANET
  actualDynamics: Bus: JointDynamics[1 4]
  targetDynamics: Bus: JointDynamics[1 4]

EtherCATReceivedFromGES = Simulink.Bus()
  timestamp: double
  imuState: Enum: SensorState
  imuInfo: Bus: IMUInfo
  buttonState: Enum: SensorState
  buttonPressed: double
  motor1TempState: Enum: SensorState
  motor1Temp: double
  motor2TempState: Enum: SensorState
  motor2Temp: double

DeviceErrors = Simulink.Bus()
  errorSOMANETs: Enum: SomanetError[1 4]
  errorInputDevice: Enum: EthercatDeviceError
  errorGES: Enum: GESError[1 3]
  errorPDB: Enum: PDBError

EtherCATData = Simulink.Bus()
  receivedFromSOMANETs: Bus: EtherCATReceivedFromSOMANET[1 4]
  receivedFromInputDevice: Bus: EtherCATReceivedFromInputDevice
  receivedFromGESs: Bus: EtherCATReceivedFromGES[1 3]
  receivedFromPDB: Bus: EtherCATReceivedFromPDB
  sendToSOMANETs: Bus: EtherCATSendToSOMANET[1 4]
  sendToInputDevice: Bus: EtherCATSendToInputDevice
  sendToPDB: Bus: EtherCATSendToPDB

EtherCATReceivedFromPDB = Simulink.Bus()
  timestamp: double
  buttonPressedPDB: double
  errorMessagePDB: double
  statusTemperatureDCDC: double
  statusCurrentBattery: double
  statusVoltageBattery: double

EtherCATSendToPDB = Simulink.Bus()
  commandPDB: Enum: PDBCommand

powerButtonMinimumPressDuration = 2
shutdownDelay = Simulink.Parameter(0.5, Unit="second")
stairsDownLeftKnee = [2; 2; 2; 2; 2; 2; 2; 2; 2; 2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 2.003093]
stairsDownLeftHip = [2; 2.000266; 2.001063; 2.002389; 2.004241; 2.006617; 2.009514; 2.012931; 2.016864; 2.021311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 2.002777]
stairsUpLeftKnee = [2; 2; 2; 2.000001; 2.000001; 2.000002; 2.000003; 2.000003; 2.000004; 2.000006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 2.005198]
stairsUpLeftHip = [2; 2; 2; 2; 2; 2; 2; 2; 2; 2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 2.002242]
stairsDownRightKnee = [2; 2; 2; 2; 2; 2; 2; 2; 2; 2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 2]
stairsDownRightHip = [2; 2.000314; 2.001256; 2.002823; 2.005014; 2.007827; 2.011261; 2.015313; 2.019983; 2.025269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 1.999767]
stairsUpRightKnee = [2; 2; 2; 2; 2; 2; 2; 2; 2; 2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 2]
stairsUpRightHip = [2; 2; 2.000001; 2.000002; 2.000004; 2.000006; 2.000009; 2.000012; 2.000016; 2.000021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 2]
initializeStandUpHip = [92; 92.00001; 92.00004; 92.0001; 92.00018; 92.00028; 92.0004; 92.00054; 92.00071; 92.00089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 94.99999]
initializeStandUpKnee = repmat(90, 900, 1)

GESCommand = Simulink.Bus()
  buzzerCmd: uint8

modelFrequency = 500
Sig = Simulink.Signal()
halfStepStandStartHip = [-1.999709; -1.999709; -1.999709; -1.999709; -1.999709; -1.999709; -1.999709; -1.999709; -1.999709; -1.999709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 -6.049875]
halfStepStandStartKnee = [2.000264; 2; 2; 2; 2; 2; 2; 2; 2; 2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 2]
halfStepStopFromStandHip = [-6; -5.970437; -5.940548; -5.910333; -5.879796; -5.848936; -5.817755; -5.786254; -5.754434; -5.722298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 -1.999709]
halfStepStopFromStandKnee = repmat(2, 850, 1)
halfStepStopFromSwingHip = [15.68863; 15.6259; 15.56304; 15.50005; 15.43695; 15.37373; 15.31039; 15.24694; 15.18336; 15.11967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 -1.999709]
halfStepStopFromSwingKnee = repmat(2, 850, 1)
halfStepSwingStartHip = [-1.999709; -1.999709; -1.999709; -1.999709; -1.999709; -1.999709; -1.999709; -1.999709; -1.999709; -1.999709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 15.75125]
halfStepSwingStartKnee = [2.000264; 2.000264; 2.003417; 2.007674; 2.013617; 2.021239; 2.030529; 2.041479; 2.054079; 2.068319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 2]
initializeSitDownHip = [-2; -1.999974; -1.999896; -1.999767; -1.999586; -1.999354; -1.999071; -1.998736; -1.99835; -1.997914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 4.999979]
initializeSitDownKnee = repmat(2, 900, 1)
sitDownHip = [5; 5.064013; 5.128078; 5.192194; 5.256361; 5.32058; 5.38485; 5.449172; 5.513544; 5.577968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 92.0000578125]
sitDownKnee = [2; 2.064008; 2.12806; 2.192153; 2.256289; 2.320467; 2.384688; 2.448951; 2.513255; 2.577602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 89.99866]
standUpHip = [95; 94.99968; 94.99871; 94.9971; 94.99485; 94.99197; 94.98844; 94.98428; 94.97948; 94.97404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 -1.999709]
standUpKnee = [90; 89.99971; 89.99883; 89.99737; 89.99533; 89.99271; 89.98951; 89.98574; 89.98138; 89.97645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 2.000264]
stepStandLegHip = [15.68863; 15.6259; 15.56304; 15.50005; 15.43695; 15.37373; 15.31039; 15.24694; 15.18336; 15.11967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 -6.049875]
stepStandLegKnee = repmat(2, 850, 1)
stepSwingLegHip = [-6; -5.970437; -5.940548; -5.910333; -5.879796; -5.848936; -5.817755; -5.786254; -5.754434; -5.722298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 15.75125]
stepSwingLegKnee = [2; 2.000856; 2.003417; 2.007674; 2.013617; 2.021239; 2.030529; 2.041479; 2.054079; 2.068319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 2]
waitTimeSitDown = 2
waitTimeStandUp = 3

ErrorInfo = Simulink.Bus()
  errorMessage: Enum: ErrorMessage
  errorLocation: Enum: ErrorLocation

MasterInfo = Simulink.Bus()
  errorMessage: Bus: ErrorInfo
  masterError: Enum: ExoskeletonError
  errorReaction: Enum: ErrorReaction
  masterState: Enum: ExoskeletonState
  stepType: Enum: StepType

EtherCATSendToInputDevice = Simulink.Bus()
  masterState: double
  errorMessage: double
  errorLocation: double

enableGraphics = Simulink.Parameter(1)